# Grasshopper definition P78_PolygonRationalization.ghx (Grasshopper 1.0.7)

crv = Curve(<curve referenced from the Rhino model>)
cdivide = CornerBasedSubdivision(C=crv, l0=Slider(10, range=0..10))
item = ListItem(List=cdivide, Index=0, Wrap=True)
boundary = BoundarySurfaces(Edges=item)

# ==== cluster CornerBasedSubdivision: Divides a closed polyline based on the corners.
C = ClusterInput()
l0 = ClusterInput()

# ---- group: if drawn on top
xy = XYPlane(Origin=Point(0, 0, 0))

# ----
explode = Explode(Curve=C, Recursive=True)  # -> Segments, Vertices
end = EndPoints(Curve=explode.Segments)  # -> Start, End
ext = ExtendCurve(Curve=explode.Segments, Type=0, Start=l0, End=l0)
cset = CreateSet(List=[end.Start, end.End])  # -> Set, Map
trim = TrimWithRegion(Curve=ext, Region=C, Plane=xy)  # -> flatten(Inside), Outside
end_2 = EndPoints(Curve=trim.Inside)  # -> Start, End
entwine = Entwine(Branch00=end_2.Start, Branch01=end_2.End, FlattenInputs=True)
flip = FlipMatrix(Data=entwine)
cset_2 = CreateSet(List=flip)  # -> Set, Map
intersection = SetIntersection(SetA=cset.Set, SetB=cset_2.Set)
srf = Surface(C)
null = NullItem(Item=intersection)  # -> flatten(NullFlags), InvalidFlags, Description
# Reference: Script by Joseph_Oster
# https://discourse.mcneel.com/t/divide-surface-based-on-corners/84805/20
dispatch = Dispatch(List=trim.Inside, DispatchPattern=invert(null.NullFlags))  # -> ListA, ListB
srfsplit = SurfaceSplit(Surface=srf, Curves=dispatch.ListA)
c_script = CSharpScript(meshes=srfsplit)  # -> out, flatten(C); inputs meshes: Mesh
# ---------- c_script: C# usings ----------
using System.IO;
using System.Linq;
using System.Data;
using System.Drawing;
using System.Reflection;
using System.Windows.Forms;
using System.Xml;
using System.Xml.Linq;
using System.Runtime.InteropServices;

using Rhino.DocObjects;
using Rhino.Collections;
using GH_IO;
using GH_IO.Serialization;
# ---------- c_script: C# ----------
    C = meshes.GetNakedEdges();
# ---------- end c_script ----------

C_2 = ClusterOutput(c_script.C)
